# Grasshopper definition rhino.compute.speckle.gh (Grasshopper 1.0.7)
# plug-ins: Speckle 2

accounts = Accounts(
    {"No account selected": , "Account (christian.j.dimitrii@gmail.com | https://speckle.xyz)": "4252b1c946"}, selected="Account (christian.j.dimitrii@gmail.com | https://speckle.xyz)",
    selectedId="4252b1c946",
    selectedServer="https://speckle.xyz")
mesh_sphere = MeshSphere(Base=PlaneXY(0, 0, 0), Radius=Slider(100, range=0..100), UCount=10, VCount=20)
streamtoggle = GetBoolean(Toggle(False), AtLeast=1, AtMost=1, FalseValue="False", TreeAccess=False, TrueValue="True")
get_account_token = GetAccountToken(Account=accounts)
streamurl = GetString("https://speckle.xyz/streams/c68047deaf", AtLeast=1, AtMost=1, TreeAccess=False)
context_bake = ContextBake(RH_OUTSphere=mesh_sphere)
streammessage = GetString("fourth commit", AtLeast=1, AtMost=1, TreeAccess=False)
stream_filter = StreamFilter(Gate=streamtoggle, Stream1=mesh_sphere)
stream_get_with_token = StreamGetWithToken(Stream=streamurl, AuthToken=get_account_token)
synchronous_sender = SynchronousSender(
    Data=stream_filter,
    Stream=stream_get_with_token,
    Message=streammessage,
    OutputWrappers="https://speckle.xyz\tc68047deaf\t7776405f91",
    UseDefaultCache=True,
    selectedKitName="Objects")
