# Grasshopper definition worm.gh (Grasshopper 1.0.7)

pt = Point([Point(-66, -353, 0), Point(-66, -227, 0), Point(100, -246, 0), Point(129, -134, 0), Point(60, -64, 0), Point(156, -22, 0)])
intcrv = Interpolate(Vertices=pt, Degree=3, Periodic=False, KnotStyle=1)  # -> Curve, Length, Domain
curve = GetGeometry(intcrv.Curve, AtLeast=1, AtMost=2147483647, DeleteInput=False, Filter=1074004029, TreeAccess=False)
crv = Curve(reparameterize(curve))
len = Length(Curve=crv)
divide = DivideCurve(Curve=crv, Count="25", Kinks=False)  # -> Points, Tangents, Parameters
multiplication = Multiplication(A=len, B="0.1")
pframe = PerpFrame(Curve=crv, Parameter=divide.Parameters)
lng = ListLength(List=divide.Parameters)
range = Range(Domain=Domain(0, 1), Steps=expr("x-1", lng))
graph = GraphMapper(
    range,
    x0=0,
    x1=1,
    y0=0,
    y1=1,
    container_name="Sine",
    Equation_px=[0.005591351073, 0.2791208327],
    Equation_py=[0.3371621966, 0.8593535423])
multiplication_2 = Multiplication(A=graph, B=multiplication)
cir = Circle(Plane=pframe, Radius=multiplication_2)
loft = Loft(Curves=cir, Options={Adjust=False, Closed=False, LoftEnds=0, LoftSimp=0, LoftType=0, Rebuild=10, Refit=0.01})
mesh_uv = MeshSurface(Surface=loft, UCount="25", VCount="25", Overhang=True, Equalize=False)
demesh = DeconstructMesh(Mesh=mesh_uv)  # -> Vertices, Faces, Colours, Normals
crv_cp = CurveClosestPoint(Point=demesh.Vertices, Curve=crv)  # -> Point, Parameter, Distance
bnd = Bounds(Numbers=crv_cp.Distance)
dedomain = DeconstructDomain(Domain=bnd)  # -> Start, End
gradient = Gradient(
    LowerLimit=dedomain.End,
    UpperLimit=dedomain.Start,
    Parameter=crv_cp.Distance,
    stops=[0: RGB(255, 79, 255), 1: RGB(0, 0, 0)])
mcol = MeshColours(Mesh=mesh_uv, Colours=gradient)

# ---- group: RH_OUT:mesh
mesh = Mesh(mcol)
